% Simulink data dictionary rl_data.sldd
% references common_data.sldd

C_MODE = enum(DefaultValue="PPO")
  PPO = 0
  TD3_SAC = 1
  MULTI = 2

INV_CONTROLLER_MODE_PPO = Simulink.Variant(Condition="INV_CONTROLLER_MODE == C_MODE.PPO")
INV_CONTROLLER_MODE_MULTI = Simulink.Variant(Condition="INV_CONTROLLER_MODE == C_MODE.MULTI")
INV_CONTROLLER_MODE_TD3_SAC = Simulink.Variant(Condition="INV_CONTROLLER_MODE == C_MODE.TD3_SAC")
RL_DESIGN_MODE_SWING_UP = Simulink.Variant(Condition="RL_DESIGN_MODE == D_MODE.SWING_UP")

D_MODE = enum(DefaultValue="SWING_UP")
  SWING_UP = 0
  SELECT_MODE = 1

RL_DESIGN_MODE_SELECT_MODE = Simulink.Variant(Condition="RL_DESIGN_MODE == D_MODE.SELECT_MODE")
rl_sample_rate = Simulink.Parameter(4)
INV_CONTROLLER_MODE = Simulink.Parameter(Simulink.data.Expression(ExpressionString="C_MODE.MULTI"), DataType="Enum: C_MODE")
RL_DESIGN_MODE = Simulink.Parameter(Simulink.data.Expression(ExpressionString="D_MODE.SELECT_MODE"), DataType="Enum: D_MODE")